# Grasshopper definition CurvedBeamOptimiser.gh (Grasshopper 1.0.7)
# plug-ins: Galapagos, Kangaroo2 Components, Alpaca4d

# ---- group: 1 - The beam
# Section Optimiser: Curved beam - a Section Optimiser example.
# 
# A 12 m beam curves up and down in a vertical plane. It is built in at its start, held up at 15% and 33% of the way along, and free beyond: a continuous beam ending in a long cantilever, with 50 kN hanging near its far end and its own weight. It is cut into 30 elements, IPE300 in S355 to begin with.
# 
# 6 - Each element on its own. No design group: each element goes to the first section of the family it starts in - the IPEs for an IPE300 - that keeps it at or below MaxUtilisation, smallest area first. The beam grows over the third support, where the cantilever's moment is largest, and thins out towards the load and the built-in start. Switch the starting section to HEA300 and it stays among the HEAs.
# 
# 7 - One section for the whole beam: a design group over every element, from the list of IPEs in the panel, tried in the order it gives them.
# 
# Reshape the curve in the two panels of 2, and move the supports and the load with their sliders: each lands on the node nearest the fraction given. The top flange is held sideways every 0.5 m, wired into LengthLT in the Design menu; sized element by element, an unrestrained beam is only a rough guide, as lateral-torsional buckling belongs to the whole member.
length_m = Slider(12, range=4..30)
rise_m = Slider(2, range=0..5)
number_of_elements = Slider(30, range=4..80)
starting_section = ValueList({"IPE300", "HEA300", "HEB300"}, selected="IPE300")
grade = ValueList({"S235", "S275", "S355"}, selected="S355")
second_support_at = Slider(0.15, range=0.05..0.95)
third_support_at = Slider(0.33, range=0.05..0.95)
load_at = Slider(0.88, range=0.05..1)
load_kn = Slider(50, range=0..200)

# ---- group: 2 - Geometry
along_of_the_length = Panel("""0
0.33
0.6
0.88
1""")
height_of_the_rise = Panel("""0
0.65
0.45
0.45
1""")
X = Expression(a=along_of_the_length, L=length_m, Expression="a*L")
Z = Expression(h=height_of_the_rise, R=rise_m, Expression="h*R")
through = ConstructPoint(XCoordinate=X, YCoordinate=0, ZCoordinate=Z)
beam = Interpolate(Vertices=through, Degree=3, Periodic=False, KnotStyle=1)  # -> Curve, Length, Domain
nodes = DivideCurve(Curve=beam.Curve, Count=number_of_elements, Kinks=False)  # -> Points, Tangents, Parameters
pline = PolyLine(Vertices=nodes.Points, Closed=False)
elements = Explode(Curve=pline, Recursive=True)  # -> Segments, Vertices

# ---- group: 4 - Supports and loads
held = BooleanToggle(True)
free = BooleanToggle(False)
start = ListItem(List=nodes.Points, Index=0, Wrap=True)
support_nodes = Expression(t=[second_support_at, third_support_at], n=number_of_elements, Expression="Round(t*n)")
load_node = Expression(t=load_at, n=number_of_elements, Expression="Round(t*n)")
supported = ListItem(List=nodes.Points, Index=support_nodes, Wrap=True)
loaded = ListItem(List=nodes.Points, Index=load_node, Wrap=True)
downwards = Expression(P=load_kn, Expression="-P")
built_in = SupportAlpaca4d(Position=start, Tx=held, Ty=held, Tz=held, Rx=held, Ry=held, Rz=held, mode="Support Rigid (Alpaca4d)")
held_up = SupportAlpaca4d(Position=supported, Tx=free, Ty=free, Tz=held, Rx=free, Ry=free, Rz=free, mode="Support Rigid (Alpaca4d)")
down = UnitZ(Factor=downwards)
load = PointLoadAlpaca4d(Point=loaded, Force=down, Moment=Vector(0, 0, 0))
self_weight = GravityLoadAlpaca4d(Factor=1)
load_pattern = LoadPatternAlpaca4d(Loads=flatten([load, self_weight]), Factor=1, mode="PlainPattern (Alpaca4d)")

# ---- group: 3 - Member
material_library_elastic = MaterialLibraryElasticAlpaca4d(
    MaterialName=grade,
    MaterialPresetElastic_Grade="S235",
    MaterialPresetElastic_Model="Uniaxial",
    MaterialPresetElastic_Type="Steel",
    menu=[dropdown(0), dropdown(1), dropdown(0)])
starting_section_2 = SteelSectionLibraryAlpaca4d(SectionName=starting_section, Material=material_library_elastic, menu=[dropdown(0), dropdown(1)])
elementid = Panel("Beam")
forcebeamcolumn = ForceBeamColumnAlpaca4d(
    Line=flatten(elements.Segments),
    Section=starting_section_2,
    Colour=RGB(1, 30, 254),
    ElementId=elementid,
    mode="ForceBeamColumn (Alpaca4d)")

# ---- group: 5 - Model
assemble_model = AssembleModelAlpaca4d(Elements=forcebeamcolumn, Supports=[built_in, held_up], LoadPatterns=load_pattern, Tolerance=0.01)  # -> AlpacaModel, Mass

# ---- group: 6 - Each element on its own, within its family
maxutilisation = Slider(1, range=0.5..1)
lateral_restraint_every_m = Slider(0.5, range=0.1..30)
each_element = SectionOptimiserAlpaca4d(
    AlpacaModel=assemble_model.AlpacaModel,
    MaxUtilisation=maxutilisation,
    Iterations=10,
    Fabrication="Rolled",
    ΓM0=1,
    ΓM1=1,
    LengthLT=lateral_restraint_every_m,
    System="Auto",
    Algorithm="Newton")  # -> AlpacaModel, Section, Utilisation, Element, Mass, Converged, Governing, Group, History, Log
section = Panel(each_element.Section)
utilisation = Panel(each_element.Utilisation)
governing = Panel(each_element.Governing)
modelview = ModelViewAlpaca4d(AlpacaModel=each_element.AlpacaModel, Step=0, FittedLoads=True)  # -> AlpacaModel, Geometry, Info, Values, Colors
mass = Panel(each_element.Mass)
history = Panel(each_element.History)

# ---- group: 7 - One section for the whole beam
ipes_in_the_order_to_try_them = Panel("""IPE80
IPE100
IPE120
IPE140
IPE160
IPE180
IPE200
IPE220
IPE240
IPE270
IPE300
IPE330
IPE360
IPE400
IPE450
IPE500
IPE550
IPE600""")
ipes = SteelSectionLibraryAlpaca4d(SectionName=ipes_in_the_order_to_try_them, Material=material_library_elastic, menu=[dropdown(0), dropdown(1)])
name = Panel("Whole beam")
design_group = DesignGroupAlpaca4d(Name=name, ElementId=elementid, Sections=ipes, Uniform=True)
whole_beam = SectionOptimiserAlpaca4d(
    AlpacaModel=assemble_model.AlpacaModel,
    DesignGroups=design_group,
    MaxUtilisation=maxutilisation,
    Iterations=10,
    Fabrication="Rolled",
    ΓM0=1,
    ΓM1=1,
    LengthLT=lateral_restraint_every_m,
    System="Auto",
    Algorithm="Newton")  # -> AlpacaModel, Section, Utilisation, Element, Mass, Converged, Governing, Group, History, Log
section_2 = Panel(whole_beam.Section)
utilisation_2 = Panel(whole_beam.Utilisation)
converged = Panel(whole_beam.Converged)
mass_2 = Panel(whole_beam.Mass)
history_2 = Panel(whole_beam.History)
